% Simulink data dictionary FCS_Data.sldd

Sample_time = Simulink.Parameter(0.02, DataType="double", Min=0.001, Max=1, Unit="s")  % ILLUSTRATIVE TRAINING DATA - Fundamental discrete execution period (50 Hz).
Ts = Simulink.Parameter(0.02, DataType="double", Min=0.001, Max=1, Unit="s")  % ILLUSTRATIVE TRAINING DATA - Alias for Sample_time used by illustrative scripts.
q_limit_normal = Simulink.Parameter(12, DataType="double", Min=0, Max=100, Unit="deg/s")  % ILLUSTRATIVE TRAINING DATA - Inclusive normal-mode pitch-rate magnitude limit.
q_fallback_command = Simulink.Parameter(0, DataType="double", Min=-100, Max=100, Unit="deg/s")  % ILLUSTRATIVE TRAINING DATA - Training fallback command used when mode or input validity is false.
pitch_Kp = Simulink.Parameter(0.6, DataType="double", Min=0, Max=20, Unit="1")  % ILLUSTRATIVE TRAINING DATA - Illustrative proportional pitch-controller gain.
pitch_Ki = Simulink.Parameter(0.025, DataType="double", Min=0, Max=20, Unit="1/s")  % ILLUSTRATIVE TRAINING DATA - Illustrative integral pitch-controller gain.
pitch_rate_Kp = Simulink.Parameter(0.3, DataType="double", Min=0, Max=20, Unit="s")  % ILLUSTRATIVE TRAINING DATA - Illustrative proportional pitch-rate controller gain.
pitch_rate_Ki = Simulink.Parameter(0.2, DataType="double", Min=0, Max=20, Unit="1")  % ILLUSTRATIVE TRAINING DATA - Illustrative integral pitch-rate controller gain.
controller_integrator_ic = Simulink.Parameter(0, DataType="double", Min=-100, Max=100, Unit="deg/s")  % ILLUSTRATIVE TRAINING DATA - Deterministic controller-integrator initial condition.
actuator_limit_deg = Simulink.Parameter(20, DataType="double", Min=0, Max=60, Unit="deg")  % ILLUSTRATIVE TRAINING DATA - Illustrative symmetric actuator-command magnitude limit.
actuator_filter_alpha = Simulink.Parameter(0.8948393, DataType="double", Min=0, Max=1, Unit="1")  % ILLUSTRATIVE TRAINING DATA - Discrete actuator lag retention coefficient at Sample_time.
aircraft_control_effectiveness = Simulink.Parameter(0.8, DataType="double", Min=0, Max=10, Unit="1/s")  % ILLUSTRATIVE TRAINING DATA - Illustrative control-to-pitch-rate effectiveness.
aircraft_pitch_damping = Simulink.Parameter(1.2, DataType="double", Min=0, Max=10, Unit="1/s")  % ILLUSTRATIVE TRAINING DATA - Illustrative longitudinal pitch-rate damping coefficient.
initial_q_rate = Simulink.Parameter(0, DataType="double", Min=-100, Max=100, Unit="deg/s")  % ILLUSTRATIVE TRAINING DATA - Deterministic initial aircraft pitch rate.
initial_pitch_angle = Simulink.Parameter(0, DataType="double", Min=-180, Max=180, Unit="deg")  % ILLUSTRATIVE TRAINING DATA - Deterministic initial aircraft pitch angle.
sensor_filter_alpha = Simulink.Parameter(0.7788008, DataType="double", Min=0, Max=1, Unit="1")  % ILLUSTRATIVE TRAINING DATA - Discrete sensor-lag retention coefficient at Sample_time.
normal_mode_code = Simulink.Parameter(uint8(2), Min=0, Max=255, Unit="1")  % ILLUSTRATIVE TRAINING DATA - Mode code treated as normal/engaged by the illustrative architecture.
actuator_tau_s = Simulink.Parameter(0.18, DataType="double", Min=0.001, Max=10, Unit="s")  % ILLUSTRATIVE TRAINING DATA - Continuous-time constant used to derive actuator_filter_alpha.
sensor_tau_s = Simulink.Parameter(0.08, DataType="double", Min=0.001, Max=10, Unit="s")  % ILLUSTRATIVE TRAINING DATA - Continuous-time constant used to derive sensor_filter_alpha.
aircraft_q_gain = Simulink.Parameter(1.4, DataType="double", Min=0, Max=10, Unit="1/s")  % ILLUSTRATIVE TRAINING DATA - Alias for aircraft_control_effectiveness.
aircraft_q_tau_s = Simulink.Parameter(0.65, DataType="double", Min=0.001, Max=20, Unit="s")  % ILLUSTRATIVE TRAINING DATA - Illustrative first-order pitch-rate time constant.
actuator_gain = Simulink.Parameter(1, DataType="double", Min=0, Max=10, Unit="1")  % ILLUSTRATIVE TRAINING DATA - Illustrative actuator static gain.
disturbance_gain = Simulink.Parameter(0.35, DataType="double", Min=0, Max=10, Unit="1")  % ILLUSTRATIVE TRAINING DATA - Illustrative disturbance scaling gain.
initial_actuator_command = Simulink.Parameter(0, DataType="double", Min=-60, Max=60, Unit="deg")  % ILLUSTRATIVE TRAINING DATA - Deterministic actuator-state initial condition.
initial_sensor_q_rate = Simulink.Parameter(0, DataType="double", Min=-100, Max=100, Unit="deg/s")  % ILLUSTRATIVE TRAINING DATA - Deterministic sensor-filter initial condition.
mode_default = Simulink.Parameter(uint8(0), Min=0, Max=255, Unit="1")  % ILLUSTRATIVE TRAINING DATA - Deterministic default mode code (FCSMode.OFF).

FlightControlBus = Simulink.Bus()  % ILLUSTRATIVE TRAINING INTERFACE - representative flight-control feedback data; not a production aircraft interface.
  q_rate: double, Unit="deg/s"  % Measured pitch rate.
  pitch_angle: double, Unit="deg"  % Measured pitch attitude.
  mach: double, Unit="1"  % Illustrative Mach number.
  air_data_valid: boolean, Unit="1"  % Air-data validity flag.
  mode: uint8, Unit="1"  % Mode code: 0 OFF, 1 ARMED, 2 ENGAGED, 3 DEGRADED.

q_cmd_in_signal = Simulink.Signal(DataType="double", Unit="deg/s", InitialValue="0")  % ILLUSTRATIVE TRAINING SIGNAL - Commanded pitch-rate input.
q_cmd_out_signal = Simulink.Signal(DataType="double", Unit="deg/s", InitialValue="0")  % ILLUSTRATIVE TRAINING SIGNAL - Limited pitch-rate command.
control_error_signal = Simulink.Signal(DataType="double", Unit="deg", InitialValue="0")  % ILLUSTRATIVE TRAINING SIGNAL - Command-minus-feedback pitch error.
actuator_command_signal = Simulink.Signal(DataType="double", Unit="deg", InitialValue="0")  % ILLUSTRATIVE TRAINING SIGNAL - Saturated illustrative actuator command.